% Simulink data dictionary modelDictionary.sldd

Ts = 1.0e-6
Motor_Pn = 4
switch_electronic_feedworward = 0
Motor_flux = 0.1827
Motor_Rs = 0.958
Motor_Observer = 0
BAK = Simulink.Signal()
Var = 0.00012
Sig = Simulink.Signal()  % 0.00012
Motor_Lq_Indctances = 0.00525
switch_subsysctrl = 3
MPTA_SubSysCtrl = 0
Motor_Ld_Indctances = 0.00012